# Dynamo graph script.dyn (Dynamo 2.12.1.8246)
# packages: Prorubim Grids Renumbering 1.0.1

поменять_цифры_с_буквами = BoolSelector(false)  # graph input
python_script = Python()  # IronPython2
# ---------- python_script.python (160 lines) ----------
#! /usr/bin/env python
# -*- coding: utf-8 -*-
import sys
import clr
clr.AddReference("System.Drawing")
clr.AddReference("System.Windows.Forms")

from System.Windows.Forms import Application, Form, FormWindowState, Screen, Label, PictureBox, PictureBoxSizeMode, \
    AnchorStyles, BorderStyle, ComboBox, ComboBoxStyle, FormBorderStyle, CheckBox, TextBox, TextBoxBase
from System.Windows.Forms import Button, LinkLabel, Panel, Button
from System.Drawing import Icon, Color, Font, Point, Size
import System.IO

#------ Глобальные настройки формы ------#
bitmapImage = System.Drawing.Bitmap(
    r"\\fs\public\Холдинг\ПоревитД\ТИМ\01_Библиотека\01_Рабочие задачи\ALL_Основные надписи\Логотип\Логотип Партнер.png")  # Логотип
titleIcon = Icon.FromHandle(bitmapImage.GetHicon())
titleText = "Обновляем номер секции"  # текст, который появляется в строке заголовка GUI
txtWith = 160 # ширина текстовой зоны
st_height = 30 # высота с кототорой начинается ввод
btnHeight = 40  # Высота кнопки
btnWidth = 100  # Ширина кнопки
btnSpacing = 20  # Интервал между кнопками + оступ элементов от края
htSpacing = 50  # Интервал между вводам данных
fontMessage = Font("Times New Roman ", 14)
fontCK = Font("Times New Roman ", 12)  # настройка шрифта у Checkbox
winSize = Size(400, 350)  # размеры winform (ширина(min = 300), высота).


def button(txt, loc, clc):
    btn = Button()
    # btnCancel.Parent = self
    btn.Text = txt
    btn.Anchor = (AnchorStyles.Bottom | AnchorStyles.Right)
    btn.Location = loc
    btn.Click += clc
    btn.Height = btnHeight
    btn.Width = btnWidth
    btn.BackColor = Color.FromArgb(220, 220, 220)
    return btn


def logo(uiH):
    logo = PictureBox()
    bitmapImage = System.Drawing.Bitmap(
        r"\\fs\public\Холдинг\ПоревитД\ТИМ\01_Библиотека\01_Рабочие задачи\ALL_Основные надписи\Логотип\Лого Партнер горизонтальный полный прозрачный фон.png")
    logo.Image = bitmapImage
    ratio = float(logo.Height) / float(logo.Width)  # должно быть значение с плавающей точкой, так как int округляется до ближайшего целого числа
    logo.Size = Size(150, 80 * ratio)  # размер логотипа
    logo.Location = Point(btnSpacing, (uiH - logo.Height) - btnSpacing)
    logo.SizeMode = PictureBoxSizeMode.Zoom  # масштабирование изображения
    logo.Anchor = (
                AnchorStyles.Bottom | AnchorStyles.Left)  # Привязка для охранения положения при масштабировании окна
    return logo


out = []
class WinForm(Form):
    def add_Logotxt(self, uiW, value):
        label_class = Label()
        font = fontMessage
        label_class.Text = value
        label_class.Font = font
        label_class.Location = Point(btnSpacing, btnSpacing)
        label_class.Height = htSpacing
        label_class.Width = uiW / 2
        return label_class

    def add_CHECKBOX(self, uiW, count=1,name="Пример ввода", value="Пример ввода!!"):
        ch_box = CheckBox()
        ch_box.Name = name
        ch_box.Text = value
        ch_box.Location = Point(btnSpacing, st_height + (count * htSpacing))
        ch_box.Width = uiW - (btnSpacing * 2)
        ch_box.Font = fontCK
        ch_box.Height = 40
        return ch_box

    def add_txtbox(self,uiW, count=1):#(self,uiW, count=1, value="Пример ввода") - если нужно в рамку добавить тест описания
        # окно ввода данных
        text_box = TextBox()
        text_box.Width = uiW / 2 - 2*btnSpacing
        #text_box.Text = value
        text_box.Font = fontCK
        text_box.Location = Point(htSpacing + txtWith, (st_height + htSpacing * count))
        return text_box

    def add_txtbox_label(self, count=1, name = "Пример ввода"):
        # текст возле ввода данных
        text_box_label = Label()
        text_box_label.Text = name
        text_box_label.Width = txtWith
        text_box_label.Font = fontCK
        text_box_label.Location = Point(btnSpacing, (st_height + htSpacing * count))
        text_box_label.Height = 50
        return text_box_label

    def okButton_pressed(self, sender, args):
        chBox_checks = []
        numErrorProvider = System.Windows.Forms.ErrorProvider()
        try:
            for lst_txtBox in self.lst_txtBoxses:
                out.append(lst_txtBox.Text)

            for i in range(len(self.lst_checkbox_index)):
                out.append((self.lst_checkbox_index)[i].Checked)
            self.Close()  # Тригер для закрытия окна
        except ValueError:
            numErrorProvider.SetError(sender, 'Must be a number')

    def __init__(self):
        #------ Настройка окна ------#
        self.CenterToScreen()  # открывать по центру экрана
        self.BringToFront()  # Выводить на предний план
        self.Icon = titleIcon
        self.Size = winSize
        uiWidth = self.DisplayRectangle.Width  # ширина формы для использования в классе
        uiHeight = self.DisplayRectangle.Height # высота формы для использования в классе
        stHeight = uiHeight / 10  # высота с которой будут начинаться поля ввода
        htSpacing = 50  # расстояни между полями ввода
        # self.FormBorderStyle = FormBorderStyle.FixedDialog  # fixed dialog stops the user from adjusting the form size. Recomended disabling this when testing to see if elements are in the wrong place.#
        self.Topmost = True # Отобрадение окна поверх других окон
        self.BackColor = Color.FromArgb(242, 242, 242)

        self.Controls.Add(logo(uiHeight))

        self.Text = titleText # Текст заголовка

        # Настройка текста в форме(можно добавить к кажой кнопке, но это гемор)

        self.Controls.Add(self.add_Logotxt(uiWidth,
                                      "Заполнить значения")
                          )
        #----- добавить ввод данных с клавиатуры -----#
        # Чекбокс
        self.cg0 = self.add_CHECKBOX(uiWidth, 2, "П", "Развернуть порядок")
        self.cg1 = self.add_CHECKBOX(uiWidth, 3 , "п2", "Поменять буквы с цифрами")
        self.lst_checkbox_index = [self.cg0,self.cg1]
        self.Controls.Add(self.cg0)
        self.Controls.Add(self.cg1)
        #Добавляем текстовый логотип ввода
        self.Controls.Add(self.add_txtbox_label(1, "Постфикс"))
        #Добавляем поле ввода
        self.txtBox_numb = self.add_txtbox(uiWidth, 1)
        self.lst_txtBoxses = [self.txtBox_numb] # формируем список из полей вставки (нужно для вывода)
        self.Controls.Add(self.txtBox_numb)

        # ----- добавить кнопку -----#
        btnOkClick = self.okButton_pressed  # Регистрация нажатия
        # Ниже одна кнопка. Для расчета нужно btnWidth * кол-во кнопок
        btnOkLoc = Point(uiWidth - ((btnWidth) + btnSpacing), uiHeight - (btnHeight + btnSpacing)) #Расчет положения.
        btnOk = button('OK', btnOkLoc, btnOkClick)
        self.Controls.Add(btnOk)


form = WinForm()
Application.Run(form)


OUT = out# print заменить на out
# ----------------------------------------
выбор_помещений = Python(IN[0]=python_script)  # IronPython2
# ---------- выбор_помещений.python (155 lines) ----------
import clr
clr.AddReference('RevitAPI')
import Autodesk
clr.AddReference("RevitAPIUI")
from Autodesk.Revit.DB import *
from Autodesk.Revit.Creation import Document as docc
from Autodesk.Revit.DB import Dimension, Transaction, XYZ, BuiltInCategory
from Autodesk.Revit.DB import Reference, IndependentTag, Transform, Line
from Autodesk.Revit.DB import IntersectionResultArray, Plane
from Autodesk.Revit.DB import ClosestPointsPairBetweenTwoCurves

from Autodesk.Revit.DB import Category, BuiltInCategory
from Autodesk.Revit.UI.Selection import ObjectType, ISelectionFilter
from Autodesk.Revit.Exceptions import OperationCanceledException
import math

clr.AddReference('ProtoGeometry')
from Autodesk.DesignScript.Geometry import *

from operator import itemgetter, attrgetter


clr.AddReference('System')
import System
from System.Collections.Generic import List

clr.AddReference("RevitNodes")
import Revit
clr.ImportExtensions(Revit.Elements)
clr.ImportExtensions(Revit.GeometryConversion)
clr.ImportExtensions(Revit.GeometryReferences)

clr.AddReference("RevitServices")
import RevitServices
from RevitServices.Persistence import DocumentManager
from RevitServices.Transactions import TransactionManager

doc = DocumentManager.Instance.CurrentDBDocument
uidoc=DocumentManager.Instance.CurrentUIApplication.ActiveUIDocument
uiapp=DocumentManager.Instance.CurrentUIApplication
app = uiapp.Application

view = doc.ActiveView
dataEnteringNode = IN

class Get_revit_elements:
    """Класс для поиска элементов в Revit."""

    @classmethod
    def get_elems_by_category(cls, category_class, active_view=None, name=None):
        """Получение элемента по классу категории."""
        if not active_view:
            els = FilteredElementCollector(doc).OfClass(category_class).\
                  ToElements()
        else:
            els = FilteredElementCollector(doc, active_view).\
                  OfClass(category_class).ToElements()
        if name:
            els = [i for i in els if name in i.Name] 
        return els

    @classmethod
    def get_elems_by_builtinCategory(cls, built_in_cat=None, include=[],
                                     active_view=None):
        """Получение элемента по встроенному классу."""
        if not include:
            if not active_view:
                els = FilteredElementCollector(doc).OfCategory(built_in_cat)
            else:
                els = FilteredElementCollector(doc, active_view).\
                      OfCategory(built_in_cat)
            return els.ToElements()
        if include:
            new_list = []
            for i in include:
                if not active_view:
                    els = FilteredElementCollector(doc).OfCategory(built_in_cat)
                else:
                    els = FilteredElementCollector(doc, active_view).\
                          OfCategory(built_in_cat)
                new_list += els.ToElements()
            return new_list

class Pick_by_category(ISelectionFilter):
    doc = uidoc.Document
    def __init__(self, built_in_category):
        if isinstance(built_in_category, Category):
            self.built_in_category = [built_in_category.Id]
        else:
            if isinstance(built_in_category, BuiltInCategory):
                built_in_category = [built_in_category]
            self.built_in_category = [Category.GetCategory(self.doc, i).Id for i in built_in_category]

    def AllowElement(self, el):
        if el.Category.Id in self.built_in_category:
            return True
        return False

    def AllowReference(self, refer, xyz):
        return False

class Pick_by_class(ISelectionFilter):
    doc = uidoc.Document
    def __init__(self, class_type):
        self.class_type = class_type

    def AllowElement(self, el):
        if isinstance(el, self.class_type):
            return True
        return False

    def AllowReference(self, refer, xyz):
        return False


class Selections:
    """Класс с реализацией различных методов выбора элементов."""

    selection = uidoc.Selection
    doc = uidoc.Document
    @classmethod
    def pick_element_by_category(cls, built_in_category):
        """Выбор одного элемента по BuiltInCategory."""
        try:
            return cls.doc.GetElement(cls.selection.PickObject(ObjectType.Element, Pick_by_category(built_in_category)))
        except OperationCanceledException:
            return
        
    
    @classmethod
    def pick_elements_by_category(cls, built_in_category):
        """Выбор нескольких элементов по категории."""
        try:
            return [cls.doc.GetElement(i) for i in cls.selection.PickObjects(ObjectType.Element, Pick_by_category(built_in_category))]
        except OperationCanceledException:
            return
	        
    @classmethod
    def pick_element_by_class(cls, class_type):
        """Выбор одного элемента по категории."""
        try:
            return cls.doc.GetElement(cls.selection.PickObject(ObjectType.Element, Pick_by_class(class_type)))
        except OperationCanceledException:
            return

    @classmethod
    def pick_elements_by_class(cls, class_type):
        """Выбор нескольких элементов  по категории."""
        try:
            return [cls.doc.GetElement(i) for i in cls.selection.PickObjects(ObjectType.Element, Pick_by_class(class_type))]
        except OperationCanceledException:
            return
            
OUT = Selections.pick_elements_by_category(BuiltInCategory.OST_Grids)
   
# ----------------------------------------
divideByOrientation = Prorubim.GridsRenumbering.Grids.DivideByOrientation(grids=выбор_помещений)
list_create = List.Create(item0=divideByOrientation.hGrids, item1=divideByOrientation.vGrids)
reverse = List.Reverse(list=list_create)
if_ = RefactoredIf(test=поменять_цифры_с_буквами, true=reverse, false=list_create)
code_block = CodeBlock(a=if_) { a[0]; a[1]; }

# group: Оси по оси Х
curve = Grid.Curve(grid=code_block.out1)
startPoint = Curve.StartPoint(curve=curve)
code_block_2 = CodeBlock(a=startPoint) { a.X; }
sortByKey = List.SortByKey(list=code_block.out1, keys=code_block_2)

count = List.Count(list=code_block.out1)
code_block_3 = CodeBlock(a=python_script) { a[0]; }

# group: Создание списка имен
префикс_осей_по_x = StringInput("")
code_block_4 = CodeBlock(C=count) { 1..C; }
code_block_5 = CodeBlock(a=префикс_осей_по_x, b=code_block_4, c=code_block_3) { a+b+c+"0"; a+b+c; }

code_block_6 = CodeBlock(a=python_script) { Разворот = a[1]; }
code_block_7 = CodeBlock(K=code_block_6) { K; }
code_block_8 = CodeBlock(a=code_block_7, b=code_block_5.out1) { a?List.Reverse(b):b; }

# group: Оси по оси Y
curve_2 = Grid.Curve(grid=code_block.out0)
startPoint_2 = Curve.StartPoint(curve=curve_2)
code_block_9 = CodeBlock(a=startPoint_2) { a.Y; }
sortByKey_2 = List.SortByKey(list=code_block.out0, keys=code_block_9)

# group: Создание списка имен
префикс_осей_по_y = StringInput("")
code_block_10 = CodeBlock(л=code_block_6) { ['А','Б','В','Г','Д','Е','Ж','И','К','Л','М','Н','П','Р','С','Т','У','Ф']; л; }

code_block_11 = CodeBlock(lst=code_block_10.out0, len=code_block.out0) { List.Chop(lst, List.Count(len))[0]; }

# group (continued): Создание списка имен
code_block_12 = CodeBlock(a=префикс_осей_по_y, b=code_block_11, c=code_block_3) { a+b+c; a+b+c+"0"; }

# group: Подмена имен
code_block_13 = CodeBlock { "Имя"; }
setParameterByName = Element.SetParameterByName(element=sortByKey.sortedList, parameterName=code_block_13, value=code_block_5.out0)
setParameterByName_2 = Element.SetParameterByName(element=sortByKey_2.sortedList, parameterName=code_block_13, value=code_block_12.out1)

code_block_14 = CodeBlock(a=code_block_10.л, b=code_block_12.out0) { a?List.Reverse(b):b; }

# group: Запись имен
code_block_15 = CodeBlock { "Имя"; }
setParameterByName_3 = Element.SetParameterByName(element=setParameterByName, parameterName=code_block_15, value=code_block_8)
setParameterByName_4 = Element.SetParameterByName(element=setParameterByName_2, parameterName=code_block_15, value=code_block_14)

code_block_16 = CodeBlock {  }
code_block_17 = CodeBlock(a=list_create) { a.Name; }
code_block_18 = CodeBlock(a=reverse) { a.Name; }
