# Dynamo graph script.dyn "Поворот на 180" (Dynamo 2.12.1.8246)

выбор_осей = Python()  # IronPython2; unwired: IN[0]
# ---------- выбор_осей.python (155 lines) ----------
import clr
clr.AddReference('RevitAPI')
import Autodesk
clr.AddReference("RevitAPIUI")
from Autodesk.Revit.DB import *
from Autodesk.Revit.Creation import Document as docc
from Autodesk.Revit.DB import Dimension, Transaction, XYZ, BuiltInCategory
from Autodesk.Revit.DB import Reference, IndependentTag, Transform, Line
from Autodesk.Revit.DB import IntersectionResultArray, Plane
from Autodesk.Revit.DB import ClosestPointsPairBetweenTwoCurves

from Autodesk.Revit.DB import Category, BuiltInCategory
from Autodesk.Revit.UI.Selection import ObjectType, ISelectionFilter
from Autodesk.Revit.Exceptions import OperationCanceledException
import math

clr.AddReference('ProtoGeometry')
from Autodesk.DesignScript.Geometry import *

from operator import itemgetter, attrgetter


clr.AddReference('System')
import System
from System.Collections.Generic import List

clr.AddReference("RevitNodes")
import Revit
clr.ImportExtensions(Revit.Elements)
clr.ImportExtensions(Revit.GeometryConversion)
clr.ImportExtensions(Revit.GeometryReferences)

clr.AddReference("RevitServices")
import RevitServices
from RevitServices.Persistence import DocumentManager
from RevitServices.Transactions import TransactionManager

doc = DocumentManager.Instance.CurrentDBDocument
uidoc=DocumentManager.Instance.CurrentUIApplication.ActiveUIDocument
uiapp=DocumentManager.Instance.CurrentUIApplication
app = uiapp.Application

view = doc.ActiveView
dataEnteringNode = IN

class Get_revit_elements:
    """Класс для поиска элементов в Revit."""

    @classmethod
    def get_elems_by_category(cls, category_class, active_view=None, name=None):
        """Получение элемента по классу категории."""
        if not active_view:
            els = FilteredElementCollector(doc).OfClass(category_class).\
                  ToElements()
        else:
            els = FilteredElementCollector(doc, active_view).\
                  OfClass(category_class).ToElements()
        if name:
            els = [i for i in els if name in i.Name] 
        return els

    @classmethod
    def get_elems_by_builtinCategory(cls, built_in_cat=None, include=[],
                                     active_view=None):
        """Получение элемента по встроенному классу."""
        if not include:
            if not active_view:
                els = FilteredElementCollector(doc).OfCategory(built_in_cat)
            else:
                els = FilteredElementCollector(doc, active_view).\
                      OfCategory(built_in_cat)
            return els.ToElements()
        if include:
            new_list = []
            for i in include:
                if not active_view:
                    els = FilteredElementCollector(doc).OfCategory(built_in_cat)
                else:
                    els = FilteredElementCollector(doc, active_view).\
                          OfCategory(built_in_cat)
                new_list += els.ToElements()
            return new_list

class Pick_by_category(ISelectionFilter):
    doc = uidoc.Document
    def __init__(self, built_in_category):
        if isinstance(built_in_category, Category):
            self.built_in_category = [built_in_category.Id]
        else:
            if isinstance(built_in_category, BuiltInCategory):
                built_in_category = [built_in_category]
            self.built_in_category = [Category.GetCategory(self.doc, i).Id for i in built_in_category]

    def AllowElement(self, el):
        if el.Category.Id in self.built_in_category:
            return True
        return False

    def AllowReference(self, refer, xyz):
        return False

class Pick_by_class(ISelectionFilter):
    doc = uidoc.Document
    def __init__(self, class_type):
        self.class_type = class_type

    def AllowElement(self, el):
        if isinstance(el, self.class_type):
            return True
        return False

    def AllowReference(self, refer, xyz):
        return False


class Selections:
    """Класс с реализацией различных методов выбора элементов."""

    selection = uidoc.Selection
    doc = uidoc.Document
    @classmethod
    def pick_element_by_category(cls, built_in_category):
        """Выбор одного элемента по BuiltInCategory."""
        try:
            return cls.doc.GetElement(cls.selection.PickObject(ObjectType.Element, Pick_by_category(built_in_category)))
        except OperationCanceledException:
            return
        
    
    @classmethod
    def pick_elements_by_category(cls, built_in_category):
        """Выбор нескольких элементов по категории."""
        try:
            return [cls.doc.GetElement(i) for i in cls.selection.PickObjects(ObjectType.Element, Pick_by_category(built_in_category))]
        except OperationCanceledException:
            return
	        
    @classmethod
    def pick_element_by_class(cls, class_type):
        """Выбор одного элемента по категории."""
        try:
            return cls.doc.GetElement(cls.selection.PickObject(ObjectType.Element, Pick_by_class(class_type)))
        except OperationCanceledException:
            return

    @classmethod
    def pick_elements_by_class(cls, class_type):
        """Выбор нескольких элементов  по категории."""
        try:
            return [cls.doc.GetElement(i) for i in cls.selection.PickObjects(ObjectType.Element, Pick_by_class(class_type))]
        except OperationCanceledException:
            return
            
OUT = Selections.pick_elements_by_category(BuiltInCategory.OST_Grids)
   
# ----------------------------------------
code_block = CodeBlock { false; }
setPinnedStatus = Element.SetPinnedStatus(element=выбор_осей, pinned=code_block)
flatten = List.Flatten(list=setPinnedStatus)
code_block_2 = CodeBlock { 180; }
count = List.Count(list=flatten)
ofRepeatedItem = List.OfRepeatedItem(item=code_block_2, amount=count)
python_script = Python(IN[0]=flatten, IN[1]=ofRepeatedItem)  # IronPython2
# ---------- python_script.python (149 lines) ----------
#Alban de Chasteigner 2020
#twitter : @geniusloci_bim
#geniusloci.bim@gmail.com
#https://github.com/albandechasteigner/GeniusLociForDynamo

import clr
clr.AddReference("RevitNodes")
import Revit
clr.ImportExtensions(Revit.GeometryConversion)

clr.AddReference("RevitAPI")
import Autodesk
from Autodesk.Revit.DB import *
import math

clr.AddReference("RevitServices")
import RevitServices
from RevitServices.Persistence import DocumentManager
from RevitServices.Transactions import TransactionManager
doc = DocumentManager.Instance.CurrentDBDocument

elements = UnwrapElement(IN[0]) if isinstance(IN[0],list) else [UnwrapElement(IN[0])]
angles = [i* math.pi/180 for i in IN[1]] if isinstance(IN[1],list) else [IN[1]* math.pi/180]

def GetCropBox(view):
	provider= ParameterValueProvider(ElementId(BuiltInParameter.ID_PARAM))
	rule = FilterElementIdRule(provider, FilterNumericEquals(), view.Id )
	filter= ElementParameterFilter(rule)
	return doc.GetElement(FilteredElementCollector(view.Document).WherePasses(filter).ToElementIds().Find(lambda x: x.IntegerValue != view.Id.IntegerValue))

TransactionManager.Instance.EnsureInTransaction(doc)
for angle, element in zip(angles, elements):
	#if angle>math.pi:
		#angle=abs(angle-2*math.pi)
	#else:angle
	#Get initial Rotation Angle using transform
	#transform=element.GetTransform()
	#vectorTran = transform.OfVector(transform.BasisX)
	#rot = transform.BasisX.AngleOnPlaneTo(vectorTran, transform.BasisZ) 
	#rot = rot * (180 / math.pi)
	if hasattr(element, "Location") and element.OwnerViewId != None :
		loc = element.Location
		if loc:	
			# Annotation symbol, importInstance and linkInstance
			if hasattr(element, "GetTotalTransform"):
				trans=element.GetTotalTransform()
				loca = trans.Origin
				rot = -trans.BasisX.AngleOnPlaneTo(XYZ.BasisX, XYZ.BasisZ)
			# point-based elements (e.g. most loadable families)
			elif isinstance(loc,LocationPoint):
				loca=loc.Point
				if hasattr(loc, "Rotation"):
					rot=loc.Rotation
				# Group, assembly
				else:rot = 0
			elif isinstance(element,MEPCurve):
				loca=loc.Curve.Evaluate(0.5,True)
				for c in element.ConnectorManager.Connectors :
					rot = math.asin(c.CoordinateSystem.Inverse.BasisY.X)
			elif isinstance(element,Grid):
				line=element.Curve
				start=line.GetEndPoint(0)
				end=line.GetEndPoint(1)   
				box=BoundingBoxXYZ()
				box.Min = start
				box.Max = end
				loca = (box.Min+box.Max)/2
				rot = 0			
			elif isinstance(element,ReferencePlane):
				doc=element.Document
				view = doc.ActiveView
				for crv in element.GetCurvesInView(DatumExtentType.ViewSpecific,view):
					line = crv
				start=line.GetEndPoint(0)
				end=line.GetEndPoint(1)   
				box=BoundingBoxXYZ()
				box.Min = start
				box.Max = end
				loca = (box.Min+box.Max)/2
				rot = 0	
			# line-based elements (e.g. walls)
			elif isinstance(loc,LocationCurve):
				loca=loc.Curve.Evaluate(0.5,True)
				rot=loc.Curve.Direction.AngleTo(XYZ.BasisX)
			# CropBox
			elif element.Category == None :
				view=doc.GetElement(element.get_Parameter(BuiltInParameter.ID_PARAM).AsElementId())
				box = view.CropBox
				transform = box.Transform
				min = transform.OfPoint(box.Min)
				max = transform.OfPoint(box.Max)
				loca = (min+max)/2
				rot = 0	
			# ViewSection Marker
			elif ElementId(BuiltInCategory.OST_Viewers) == element.Category.Id :
				viewSection = doc.GetElement(ElementId(element.Id.IntegerValue + 1))
				shape=viewSection.GetCropRegionShapeManager().GetCropShape()
				#Last line of the rectangle
				l=[s for s in shape[0]][3]
				loca = l.Evaluate(0.5, True)
				#loca = viewSection.Origin
				rot = 0
			# SectionBox
			elif ElementId(BuiltInCategory.OST_SectionBox) == element.Category.Id:
				box = doc.GetElement(ElementId(element.Id.IntegerValue + 1)).GetSectionBox()
				transform = box.Transform
				min = transform.OfPoint(box.Min)
				max = transform.OfPoint(box.Max)
				loca = (min+max)/2
				rot = 0
			else:
				box = element.get_BoundingBox(None)
				loca = (box.Min+box.Max)/2
				rot = 0
				# sketch-based elements (ceiling, floor and roof)
				if hasattr(element, "FindInserts"):
					for ref in HostObjectUtils.GetTopFaces(element):
						geomFace=element.GetGeometryObjectFromReference(ref)
						#Get BoundingBox max UV point
						maxUV = geomFace.GetBoundingBox().Max
						#Get transform
						trans=geomFace.ComputeDerivatives(maxUV)
						if isinstance(element,Ceiling):
							rot = abs(trans.BasisZ.AngleOnPlaneTo(XYZ.BasisX, XYZ.BasisZ)-2*math.pi)
						else:
							rot = abs(trans.BasisY.AngleOnPlaneTo(XYZ.BasisX, XYZ.BasisZ)-math.pi)
				else:rot = 0
		#PlanView, SectionView and 3D View
		elif hasattr(element, "CropBox") :
			box = element.CropBox
			element = GetCropBox(element)
			transform = box.Transform
			min = transform.OfPoint(box.Min)
			max = transform.OfPoint(box.Max)
			loca = (min+max)/2
			rot = 0			
	# view specific elements (e.g. filled regions)
	elif hasattr(element, "OwnerViewId"):
		view=doc.GetElement(element.OwnerViewId)
		box = element.BoundingBox[view]
		loca = (box.Min+box.Max)/2
		rot = 0
	line = Line.CreateBound(loca, XYZ(loca.X,loca.Y,loca.Z+1))
	#Set Rotation
	Autodesk.Revit.DB.ElementTransformUtils.RotateElement(doc, element.Id, line, angle - rot)
TransactionManager.Instance.TransactionTaskDone()

if isinstance(IN[0], list): OUT = elements
else: OUT = elements[0]
# ----------------------------------------
code_block_3 = CodeBlock { true; }
setPinnedStatus_2 = Element.SetPinnedStatus(element=python_script, pinned=code_block_3)
